# Grasshopper definition sdTF-to-glTF.ghx (Grasshopper 1.0.8)
# plug-ins: ShapeDiverForGrasshopper

sddp = ShapeDiverDocumentPayload({AbsoluteTolerance=0, AngleTolerance=0, DistanceDisplayPrecision=0, GltfVersion="Gltf2", GrasshopperVersion="1.0.0008", InputGroups="{}", OutputGroups="{}", RelativeTolerance=0, RhinoVersion="8.11.24254.15001", UnitSystem=0, VersionCreated="1.20.0.0", VersionSaved="1.20.0.0"})

# ---- group: SD_Inputs
crv = Curve()
brep = Brep()
mesh = Mesh()

# ----
geo = Geometry([mesh, crv, brep])
gltfdisplay = GlTF20Display(Geometry=geo)
